# Grasshopper definition DeBoorAlgorithmNurbs.gh (Grasshopper 1.0.7)

isperiodic = BooleanToggle(False)
pt = Point([Point(19.13106505, 37.32878588, 0), Point(10.71774169, 77.18137019, 0), Point(32.41525982, 90.24416172, 0), Point(88.43028111, 90.68696821, 0), Point(69.83240843, 41.09264107, 0), Point(109.906396, 64.11857867, 0)])
path = FilePath("/Users/apple/Documents/caad/repos/DeBoorAlgorithmNurbs/src/BezierCurve.py")
pt_2 = Point([Point(-100.9535748, 40.18537361, 0), Point(-90.82996956, 98.90228389, 0), Point(-48.31082763, 104.30154, 0), Point(-28.4010707, 36.81083854, 0)])
file = ReadFile(File=path, PerLineParse=False)
lng = ListLength(List=pt)
lng_2 = ListLength(List=pt_2)
cir = Circle(Plane=PlaneXY(168.0102357, 67.28850409, 0), Radius="30")
subtraction = Subtraction(A=lng_2, B="1")
knots = KnotVector(Count=lng, Degree="3", Periodic=isperiodic)
cp = ControlPoints(Curve=cir)  # -> Points, Weights, Knots
panel = Panel(knots)
beziercurve = GhPythonScript(Code=file, Pts=pt_2, Nums="50")  # -> Out, CurvePoints
item = ListItem(List=cp.Knots, Index=-1, Wrap=True)
item_2 = ListItem(List=knots, Index=-1, Wrap=True)
nurbs = NurbsCurve(Vertices=pt_2, Degree=subtraction, Periodic=False)  # -> Curve, Length, Domain
remap = RemapNumbers(Value=Slider(0.384, range=0..1), Source=Domain(0, 1), Target=item)  # -> Mapped, Clipped
remap_2 = RemapNumbers(Value=Slider(0.85, range=0..1), Source=Domain(0, 1), Target=item_2)  # -> Mapped, Clipped
panel_2 = Panel(remap.Mapped)
panel_3 = Panel(cp.Points)
panel_4 = Panel(cp.Knots)
panel_5 = Panel(cp.Weights)
panel_6 = Panel(remap_2.Mapped)
path_2 = FilePath("C:\msys64\home\mahai\repos\debooralgorithm\src\DeBoorAlgorithmNurbs.py")
file_2 = ReadFile(File=path_2, PerLineParse=False)
debooralgorithmnurbs = GhPythonScript(Code=file_2, Points=pt, Knots=knots, Degree="3", U=remap_2.Mapped, IsPeriodic=isperiodic, IsRational=Toggle(False))  # -> Out, CurvePoints, DeBoorlines, PointAtU
path_3 = FilePath("C:\msys64\home\mahai\repos\debooralgorithm\src\DeBoorAlgorithmNurbs.py")
file_3 = ReadFile(File=path_3, PerLineParse=False)
debooralgorithmnurbs_2 = GhPythonScript(
    Code=file_3,
    Points=panel_3,
    Weights=panel_5,
    Knots=panel_4,
    Degree="2",
    U=remap.Mapped,
    IsPeriodic=Toggle(True),
    IsRational=Toggle(True))  # -> CurvePoints, DeBoorlines, PointAtU
col = Colour(RGB(255, 255, 255))
preview = CustomPreview(Geometry=[debooralgorithmnurbs.DeBoorlines, debooralgorithmnurbs.PointAtU], Material=col)
col_2 = Colour(RGB(255, 255, 255))
preview_2 = CustomPreview(Geometry=[debooralgorithmnurbs_2.PointAtU, debooralgorithmnurbs_2.DeBoorlines], Material=col_2)
